# Grasshopper definition Metal Rod Bending For ABB.gh (Grasshopper 1.0.7)
# plug-ins: Robots, Human, Palette

X = UnitX(Factor=1)

pt = ConstructPoint(XCoordinate=0, YCoordinate=0, ZCoordinate=0)
line = LineSDL(Start=pt, Direction=X, Length=Slider(250, range=0..1000))

vec = VectorXYZ(XComponent=Slider(490, range=0..1000), YComponent=Slider(154, range=0..1000), ZComponent=Slider(120, range=0..1000))  # -> Vector, Length
number_slider = Slider(3, range=0..10)
number_slider_2 = Slider(0, range=0..10)
number_slider_3 = Slider(1, range=0..10)

# ----
# Doubleclick Me!
toggle = BooleanToggle(True)
number_slider_4 = Slider(1988, range=0..6590)

panel = Panel("100,100")  # disabled
texttoscreen = RenderTextToScreen(Text=number_slider_4, Location=panel, Size=12, Color=RGB(0, 0, 0), m_scWithvp=False)  # disabled

# ---- group: pin number
panel_2 = Panel("""1
2
3""")

# ----
# current state FALSE
panel_3 = Panel("8")
subtraction = Subtraction(A=panel_3, B="1")
setdo = SetDO(DO=subtraction, Value="0")

# ----
# current state TRUE
panel_4 = Panel("8")
subtraction_2 = Subtraction(A=panel_4, B="1")
setdo_2 = SetDO(DO=subtraction_2, Value="1")

subtraction_3 = Subtraction(A=panel_2, B=Slider(1, range=0..1))

# ---- group: pin number
panel_5 = Panel("""4
5
6
7""")

# ----
# current state FALSE
panel_6 = Panel("1")
subtraction_4 = Subtraction(A="8", B=panel_6)
setdo_3 = SetDO(DO=subtraction_4, Value="0")

# ---- group: pin number
panel_7 = Panel("""1
2
3""")

# ----
# current state TRUE
panel_8 = Panel("8")
subtraction_5 = Subtraction(A=panel_8, B="1")
setdo_4 = SetDO(DO=subtraction_5, Value="1")

# ----
# Set Robot Path
number_slider_5 = Slider(250, range=0..1000)
division = Division(A=number_slider_5, B="2")
neg = Negative(Value=division)
pt_2 = ConstructPoint(XCoordinate=Slider(500, range=-500..1000), YCoordinate=neg, ZCoordinate=Slider(120, range=0..1000))
Y = UnitY(Factor=1)
line_2 = LineSDL(Start=pt_2, Direction=Y, Length=number_slider_5)
crv = Curve(line_2)
end = EndPoints(Curve=crv)  # -> Start, End
pln = Plane(end.End)
pln_2 = Plane(end.Start)
Z = UnitZ(Factor=Slider(100, range=0..100))
move = Move(Geometry=pln, Motion=Z)  # -> Geometry, Transform
move_2 = Move(Geometry=pln_2, Motion=Z)  # -> Geometry, Transform

panel_9 = Panel("{68.244, 2.632, 258.162}")
smooth = SettingsQuality()
brep = Brep([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])
mesh = MeshBrep(Brep=brep, Settings=smooth)
mjoin = MeshJoin(Meshes=mesh)
pl = PlaneNormal(Origin="{0, 0, 130}", ZAxis="{0,0,-1}")
tool = CreateTool(Name="gripper", TCP=pl, Weight=0)  # -> Tool, TCP

# ----
# GripperPin
panel_10 = Panel("10")
subtraction_6 = Subtraction(A=panel_10, B=1)

panel_11 = Panel("""0
1
2
3
4
5
6
7""")
panel_12 = Panel("""0
0
0
0
0
0
0
0""")

# ----
# Gripper close Com
panel_13 = Panel("True")
setdo_5 = SetDO(DO=subtraction_6, Value=panel_13)

setdo_6 = SetDO(DO=panel_11, Value=panel_12)

# ---- group: P2
pln_3 = Plane(pln)

# ----
tool_2 = ToolParameter(tool.Tool)

# ---- group: P1
pln1 = Plane(pln_2)

# ---- group: P3
pln_4 = Plane(move.Geometry)

# ---- group: P4
pln_5 = Plane(move_2.Geometry)

# ----
panel_14 = Panel("""0
1
2
3
4
5
6
7
8""")
panel_15 = Panel("""0
0
0
0
0
0
0
0
0""")
setdo_7 = SetDO(DO=panel_14, Value=panel_15)
groupcmd = GroupCommand(Commands=setdo_7)  # -> flatten(Command)

# ----
# select robot
list = ValueList({"AA-KR60", "AA-KR30", "AA-KR60_KR30", "AARCH IRB120", "AARCH IRB6620", "AAU-Utzon-UR10", "Automata", "Bartlett-IRB120", "Bartlett-IRB1600", "Bartlett-KR6"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}, selected="iaac-IRB120")
load_robot = LoadRobotSystem(Name=list, Base=PlaneXY(0, 0, 0))

# ----
# bit calculation
amount_of_bits = Panel("4")
desired_number = Panel("15")
ln = NaturalLogarithm(Value="2")
ln_2 = NaturalLogarithm(Value=desired_number)
_2º = PowerOf2(Value=amount_of_bits)
division_2 = Division(A=ln_2, B=ln)
subtraction_7 = Subtraction(A=_2º, B="1")
amount_of_bits_2 = Panel(division_2)
highest_number = Panel(subtraction_7)

palette = Palette(
    ModeCustomStandard=Toggle(True),
    Component_Normal_Deselected_Fill_Color=RGB(200, 200, 200),
    Component_Normal_Deselected_Edge_Color=RGB(50, 50, 50),
    Component_Normal_Deselected_Text_Color=RGB(0, 0, 0),
    Component_Normal_Selected_Fill_Color=RGB(130, 215, 50),
    Component_Normal_Selected_Edge_Color=RGB(0, 50, 0),
    Component_Normal_Selected_Text_Color=RGB(0, 25, 0),
    Component_Hidden_Deselected_Fill_Color=RGB(140, 140, 155),
    Component_Hidden_Deselected_Edge_Color=RGB(35, 35, 35),
    Component_Hidden_Deselected_Text_Color=RGB(0, 0, 0),
    Component_Hidden_Selected_Fill_Color=RGB(80, 180, 10),
    Component_Hidden_Selected_Edge_Color=RGB(0, 35, 0),
    Component_Hidden_Selected_Text_Color=RGB(0, 25, 0),
    Component_Disabled_Deselected_Fill_Color=RGB(120, 120, 120),
    Component_Disabled_Deselected_Edge_Color=RGB(90, 90, 90),
    Component_Disabled_Deselected_Text_Color=RGB(70, 70, 70),
    Component_Disabled_Selected_Fill_Color=RGB(110, 150, 115),
    Component_Disabled_Selected_Edge_Color=RGB(40, 70, 40),
    Component_Disabled_Selected_Text_Color=RGB(75, 100, 65),
    Component_Warning_Deselected_Fill_Color=RGB(255, 140, 20),
    Component_Warning_Deselected_Edge_Color=RGB(80, 10, 0),
    Component_Warning_Deselected_Text_Color=RGB(0, 0, 0),
    Component_Warning_Selected_Fill_Color=RGB(185, 205, 0),
    Component_Warning_Selected_Edge_Color=RGB(0, 50, 0),
    Component_Warning_Selected_Text_Color=RGB(0, 0, 0),
    Component_Error_Deselected_Fill_Color=RGB(200, 0, 0),
    Component_Error_Deselected_Edge_Color=RGB(60, 0, 0),
    Component_Error_Deselected_Text_Color=RGB(0, 0, 0),
    Component_Error_Selected_Fill_Color=RGB(125, 155, 0),
    Component_Error_Selected_Edge_Color=RGB(0, 50, 0),
    Component_Error_Selected_Text_Color=RGB(255, 255, 255),
    Component_Label_Deselected_Fill_Color=RGB(50, 50, 50),
    Component_Label_Deselected_Edge_Color=RGB(0, 0, 0),
    Component_Label_Deselected_Text_Color=RGB(255, 255, 255),
    Component_Label_Selected_Fill_Color=RGB(25, 60, 25),
    Component_Label_Selected_Edge_Color=RGB(0, 35, 0),
    Component_Label_Selected_Text_Color=RGB(190, 250, 180),
    Galapagos_Deselected_Fill_Color=RGB(255, 0, 125),
    Galapagos_Deselected_Edge_Color=RGB(100, 0, 50),
    Galapagos_Selected_Fill_Color=RGB(160, 210, 30),
    Galapagos_Selected_Edge_Color=RGB(0, 50, 0),
    Wire_Normal_Color=RGBA(0, 0, 0, 150),
    Wire_Empty_Color=RGBA(255, 60, 0, 180),
    Wire_Selected_Start_Color=RGB(125, 210, 40),
    Wire_Selected_End_Color=RGBA(0, 0, 0, 50),
    Panel_Default_Color=RGB(255, 250, 90),
    Group_Default_Color=RGBA(170, 135, 225, 150),
    Canvas_Background_Color=ColourSwatch(SwatchColor=RGB(255, 255, 255)),
    Canvas_Gridline_Color=ColourSwatch(SwatchColor=RGB(255, 255, 255)),
    Canvas_Gridline_Width=150,
    Canvas_Gridline_Height=50,
    Canvas_Edge_Color=RGB(0, 0, 0),
    Canvas_Shadow_Color=RGBA(0, 0, 0, 80),
    Canvas_Shadow_Size=30,
    MonochromaticOnOff=False,
    Monochromatic_Color=RGB(212, 208, 200))

divide = DivideCurve(Curve=line, Count="2", Kinks=False)  # -> graft(Points), Tangents, Parameters
bang = ExplodeTree(Data=divide.Points)  # -> Branch0, Branch1, Branch2
unit = Panel("4")
series = Series(Start=0, Step=1, Count=Slider(13, range=0..15))
multiplication = Multiplication(A=unit, B=series)
pdecon = Deconstruct(Point=bang.Branch0)  # -> XComponent, YComponent, ZComponent
pdecon_2 = Deconstruct(Point=bang.Branch2)  # -> XComponent, YComponent, ZComponent
pdecon_3 = Deconstruct(Point=bang.Branch1)  # -> XComponent, YComponent, ZComponent
addition = Addition(A=multiplication, B=pdecon.YComponent)
subtraction_8 = Subtraction(A=pdecon.YComponent, B=multiplication)
addition_2 = Addition(A=pdecon_2.YComponent, B=multiplication)
subtraction_9 = Subtraction(A=pdecon_3.YComponent, B=multiplication)
subtraction_10 = Subtraction(A=pdecon_2.YComponent, B=multiplication)
addition_3 = Addition(A=multiplication, B=pdecon_3.YComponent)
# 1
pt_3 = ConstructPoint(XCoordinate=pdecon.XComponent, YCoordinate=addition, ZCoordinate=pdecon.ZComponent)
# 2
pt_4 = ConstructPoint(XCoordinate=pdecon.XComponent, YCoordinate=subtraction_8, ZCoordinate=pdecon.ZComponent)
# 3
pt_5 = ConstructPoint(XCoordinate=pdecon_3.XComponent, YCoordinate=addition_3, ZCoordinate=pdecon_3.ZComponent)
# 5
pt_6 = ConstructPoint(XCoordinate=pdecon_2.XComponent, YCoordinate=addition_2, ZCoordinate=pdecon_2.ZComponent)
# 6
pt_7 = ConstructPoint(XCoordinate=pdecon_2.XComponent, YCoordinate=subtraction_10, ZCoordinate=pdecon_2.ZComponent)
# 4
pt_8 = ConstructPoint(XCoordinate=pdecon_3.XComponent, YCoordinate=subtraction_9, ZCoordinate=pdecon_3.ZComponent)

filter = StreamFilter(Gate=toggle, Stream0=[pt_3, pt_8, pt_6], Stream1=[pt_4, pt_5, pt_7])
bang_2 = ExplodeTree(Data=filter)  # -> Branch0, Branch1, Branch2

flip = FlipMatrix(Data=filter)
points = PointList(Points=filter, Size=Slider(7, range=0..10))

crossref = CrossReference(ListA=bang_2.Branch0, ListB=bang_2.Branch1, ListC=bang_2.Branch2, CrossMode=1)  # -> ListA, ListB, ListC
entwine = Entwine(Branch00=crossref.ListA, Branch01=crossref.ListB, Branch02=crossref.ListC, FlattenInputs=True)
flip_2 = FlipMatrix(Data=entwine)

bang_3 = ExplodeTree(Data=entwine)  # -> Branch0, Branch1, Branch2
item = ListItem(List=bang_3.Branch2, Index=0, Wrap=True)
pdecon_4 = Deconstruct(Point=item)  # -> XComponent, YComponent, ZComponent
vec_2 = VectorXYZ(XComponent=pdecon_4.XComponent, YComponent=0, ZComponent=0)  # -> Vector, Length
move_3 = Move(Geometry=flip_2, Motion=vec_2.Vector)  # -> Geometry, Transform
lng = ListLength(List=crossref.ListA)
addition_4 = Addition(A=lng, B=Slider(63, range=0..100))
data = Data(move_3.Geometry)
addition_5 = Addition(A=number_slider_4, B=addition_4)
tstat = TreeStatistics(Tree=data)  # -> Paths, Length, Count
abs = Absolute(Value=addition_5)
item_2 = ListItem(List=tstat.Paths, Index=abs, Wrap=True)
branch = TreeBranch(Tree=data, Path=item_2, MaintainPaths=True)
flatten = FlattenTree(Tree=branch, Path="{1}")
merge = Merge(Data1=flatten(divide.Points), Data2=flatten)
flip_3 = FlipMatrix(Data=merge)
reldif = RelativeDifferences(Values=flip_3)
pdecon_5 = Deconstruct(Point=reldif)  # -> XComponent, YComponent, ZComponent
item_3 = ListItem(List=pdecon_5.YComponent, Index=-1, Wrap=True)
abs_2 = Absolute(Value=item_3)
not = GateNot(A=toggle)
panel_16 = Panel("""1
4
5""")
panel_17 = Panel("""2
3
6""")
division_3 = Division(A=flatten(abs_2), B=10)
filter_2 = StreamFilter(Gate=toggle, Stream0=panel_16, Stream1=panel_17)

bang_4 = ExplodeTree(Data=entwine)  # -> Branch0, Branch1, Branch2
item_4 = ListItem(List=bang_4.Branch2, Index=0, Wrap=True)
pdecon_6 = Deconstruct(Point=item_4)  # -> XComponent, YComponent, ZComponent
vec_3 = VectorXYZ(XComponent=pdecon_6.XComponent, YComponent=0, ZComponent=0)  # -> Vector, Length
move_4 = Move(Geometry=flip_2, Motion=vec_3.Vector)  # -> Geometry, Transform
lng_2 = ListLength(List=crossref.ListA)
addition_6 = Addition(A=lng_2, B=Slider(194, range=0..1100))
data_2 = Data(move_4.Geometry)
addition_7 = Addition(A=number_slider_4, B=addition_6)
tstat_2 = TreeStatistics(Tree=data_2)  # -> Paths, Length, Count
abs_3 = Absolute(Value=addition_7)
item_5 = ListItem(List=tstat_2.Paths, Index=abs_3, Wrap=True)
branch_2 = TreeBranch(Tree=data_2, Path=item_5, MaintainPaths=True)
flatten_2 = FlattenTree(Tree=branch_2, Path="{1}")
merge_2 = Merge(Data1=flatten(divide.Points), Data2=flatten_2)
flip_4 = FlipMatrix(Data=merge_2)
reldif_2 = RelativeDifferences(Values=flip_4)
pdecon_7 = Deconstruct(Point=reldif_2)  # -> XComponent, YComponent, ZComponent
item_6 = ListItem(List=pdecon_7.YComponent, Index=-1, Wrap=True)
abs_4 = Absolute(Value=item_6)
not_2 = GateNot(A=toggle)
panel_18 = Panel("""1
4
5""")
panel_19 = Panel("""2
3
6""")
division_4 = Division(A=flatten(abs_4), B=10)
filter_3 = StreamFilter(Gate=toggle, Stream0=panel_18, Stream1=panel_19)

bang_5 = ExplodeTree(Data=move_3.Geometry)  # -> Branch0, Branch1, Branch2
item_7 = ListItem(List=bang_5.Branch2, Index=0, Wrap=True)
pdecon_8 = Deconstruct(Point=item_7)  # -> XComponent, YComponent, ZComponent
vec_4 = VectorXYZ(XComponent=pdecon_8.XComponent, YComponent=0, ZComponent=0)  # -> Vector, Length
move_5 = Move(Geometry=flip_2, Motion=vec_4.Vector)  # -> Geometry, Transform
lng_3 = ListLength(List=crossref.ListA)
addition_8 = Addition(A=lng_3, B=Slider(129, range=0..300))
data_3 = Data(move_5.Geometry)
addition_9 = Addition(A=number_slider_4, B=addition_8)
tstat_3 = TreeStatistics(Tree=data_3)  # -> Paths, Length, Count
abs_5 = Absolute(Value=addition_9)
item_8 = ListItem(List=tstat_3.Paths, Index=abs_5, Wrap=True)
branch_3 = TreeBranch(Tree=data_3, Path=item_8, MaintainPaths=True)
flatten_3 = FlattenTree(Tree=branch_3, Path="{1}")
merge_3 = Merge(Data1=flatten(divide.Points), Data2=flatten_3)
flip_5 = FlipMatrix(Data=merge_3)
reldif_3 = RelativeDifferences(Values=flip_5)
pdecon_9 = Deconstruct(Point=reldif_3)  # -> XComponent, YComponent, ZComponent
item_9 = ListItem(List=pdecon_9.YComponent, Index=-1, Wrap=True)
abs_6 = Absolute(Value=item_9)
panel_20 = Panel("""1
4
5""")
panel_21 = Panel("""2
3
6""")
division_5 = Division(A=flatten(abs_6), B=10)
filter_4 = StreamFilter(Gate=toggle, Stream0=panel_20, Stream1=panel_21)

intcrv = Interpolate(Vertices=flip_2, Degree=3, Periodic=False, KnotStyle=1)  # -> Curve, Length, Domain

# ----
# Curve Part 3
shift = ShiftList(List=filter_4, Shift=number_slider_2, Wrap=True)
shift_2 = ShiftList(List=division_5, Shift=number_slider_2, Wrap=True)

# ----
# Curve Part 4
shift_3 = ShiftList(List=filter_3, Shift=number_slider, Wrap=True)
shift_4 = ShiftList(List=division_4, Shift=number_slider, Wrap=True)

# ----
# Curve Part 2
shift_5 = ShiftList(List=filter_2, Shift=number_slider_3, Wrap=True)
shift_6 = ShiftList(List=division_3, Shift=number_slider_3, Wrap=True)

data_4 = Data(flip_2)
tstat_4 = TreeStatistics(Tree=data_4)  # -> Paths, Length, Count
item_10 = ListItem(List=tstat_4.Paths, Index=number_slider_4, Wrap=True)
branch_4 = TreeBranch(Tree=data_4, Path=item_10, MaintainPaths=True)
flatten_4 = FlattenTree(Tree=branch_4, Path="{1}")
merge_4 = Merge(Data1=flatten(divide.Points), Data2=flatten_4)
flip_6 = FlipMatrix(Data=merge_4)
reldif_4 = RelativeDifferences(Values=flip_6)
pdecon_10 = Deconstruct(Point=reldif_4)  # -> XComponent, YComponent, ZComponent
item_11 = ListItem(List=pdecon_10.YComponent, Index=-1, Wrap=True)
abs_7 = Absolute(Value=item_11)
division_6 = Division(A=flatten(abs_7), B=10)

rotate = Rotate(Geometry=[branch_4, branch, branch_3, branch_2], Angle=1.570796327, Plane=PlaneXY(0, 0, 0))  # -> Geometry, Transform
panel_22 = Panel(branch_4)
move_6 = Move(Geometry=rotate.Geometry, Motion=vec.Vector)  # -> Geometry, Transform

intcrv_2 = Interpolate(Vertices=move_6.Geometry, Degree=3, Periodic=False, KnotStyle=1)  # -> Curve, Length, Domain

# ----
# Curve Part 1
panel_23 = Panel("""1
4
5""")
panel_24 = Panel("""2
3
6""")
number_slider_6 = Slider(2, range=0..10)
filter_5 = StreamFilter(Gate=toggle, Stream0=panel_23, Stream1=panel_24)
shift_7 = ShiftList(List=division_6, Shift=number_slider_6, Wrap=True)
shift_8 = ShiftList(List=filter_5, Shift=number_slider_6, Wrap=True)

number_slider_7 = Slider(-25, range=-30..100)  # disabled
number_slider_8 = Slider(0, range=0..1000)  # disabled
vec_5 = VectorXYZ(XComponent=number_slider_7, YComponent=number_slider_8, ZComponent=0)  # -> Vector, Length; disabled
move_7 = Move(Geometry=move_6.Geometry, Motion=vec_5.Vector)  # -> Geometry, Transform; disabled
number_slider_9 = Slider(6, range=0..10)  # disabled
ln_3 = Line(StartPoint=move_6.Geometry, EndPoint=move_7.Geometry)  # disabled
panel_25 = Panel(""",cm to move:
,cm to move:
,cm to move:""")  # disabled
concat = Concatenate(FragmentA=filter_5, FragmentB=panel_25, FragmentC=division_6)  # disabled
swatch = ColourSwatch(SwatchColor=RGB(173, 173, 173))  # disabled
previewlw = CustomPreviewLineweights(Geometry=intcrv_2.Curve, Shader=swatch, Thickness=number_slider_9, Absolute=False)  # disabled

# ----
# step calculation
cm_to_move = Panel(shift_7)
panel_26 = Panel(shift_6)
panel_27 = Panel(shift_2)
panel_28 = Panel(shift_4)
steps_per_revolution = Panel("200")
_0_8_cm_per_revolution = Panel("0.8")
merge_5 = Merge(Data1=cm_to_move, Data2=panel_26, Data3=panel_27, Data4=panel_28)
resolution = Panel("100")
division_7 = Division(A=steps_per_revolution, B=_0_8_cm_per_revolution)
multiplication_2 = Multiplication(A=division_7, B=merge_5)
division_8 = Division(A=multiplication_2, B=resolution)
c_script = CSharpScript(Dec=division_8)  # -> Bin; inputs Dec: Int32
# ---------- c_script: C# ----------
Bin = Convert.ToString(Dec, 2);
# ---------- end c_script ----------
chars = Characters(Text=c_script)  # -> Result, Unicode
lng_4 = ListLength(List=chars.Result)
subtraction_11 = Subtraction(A="4", B=lng_4)
repeat = RepeatData(Data="0", Length=subtraction_11)
join = TextJoin(Text=repeat)
concat_2 = Concatenate(FragmentA=flatten(join), FragmentB=c_script)
chars_2 = Characters(Text=concat_2)  # -> Result, Unicode
bool = Boolean(chars_2.Result)
subtraction_12 = Subtraction(A=panel_5, B=Slider(1, range=0..1))
setdo_8 = SetDO(DO=subtraction_12, Value=bool)  # -> simplify(Command)

panel_29 = Panel(multiplication_2)

# ----
# select dir
panel_30 = Panel(shift)
panel_31 = Panel("""1 = Xpositive 
2 = Xnegative
3 = Ypositive
4 = Ynegative
5 = Zpositive
6 = Znegative""")
panel_32 = Panel(shift_8)
panel_33 = Panel(shift_5)
panel_34 = Panel(shift_3)
merge_6 = Merge(Data1=panel_32, Data2=panel_33, Data3=panel_30, Data4=panel_34)  # -> flatten(Result)
c_script_2 = CSharpScript(Dec=merge_6)  # -> Bin; inputs Dec: Int32; same code as c_script
chars_3 = Characters(Text=c_script_2)  # -> Result, Unicode
lng_5 = ListLength(List=chars_3.Result)
subtraction_13 = Subtraction(A="3", B=lng_5)
repeat_2 = RepeatData(Data="0", Length=subtraction_13)
join_2 = TextJoin(Text=repeat_2)
concat_3 = Concatenate(FragmentA=flatten(join_2), FragmentB=c_script_2)

# ----
# select dir
panel_35 = Panel(shift_8)
panel_36 = Panel(shift_5)
panel_37 = Panel(shift_3)
panel_38 = Panel(shift)
# reverse direction
data_5 = Data(merge_6)
eval = Evaluate(F="x%2=0", x=data_5)
dispatch = Dispatch(List=data_5, DispatchPattern=eval)  # -> ListA, ListB
subtraction_14 = Subtraction(A=dispatch.ListA, B="1")
addition_10 = Addition(A=dispatch.ListB, B="1")
weave = Weave(Pattern=eval, Stream0=addition_10, Stream1=subtraction_14, NullGaps=False)
c_script_3 = CSharpScript(Dec=weave)  # -> Bin; inputs Dec: Int32; same code as c_script
chars_4 = Characters(Text=c_script_3)  # -> Result, Unicode
lng_6 = ListLength(List=chars_4.Result)
subtraction_15 = Subtraction(A="3", B=lng_6)
repeat_3 = RepeatData(Data="0", Length=subtraction_15)
join_3 = TextJoin(Text=repeat_3)
concat_4 = Concatenate(FragmentA=flatten(join_3), FragmentB=c_script_3)
chars_5 = Characters(Text=concat_4)  # -> Result, Unicode
bool_2 = Boolean(chars_5.Result)
rev = ReverseList(List=bool_2)
subtraction_16 = Subtraction(A=panel_7, B=Slider(1, range=0..1))
setdo_9 = SetDO(DO=subtraction_16, Value=bool_2)  # -> simplify(Command)

panel_40 = Panel(merge_6)
chars_6 = Characters(Text=concat_3)  # -> Result, Unicode

bool_3 = Boolean(chars_6.Result)
setdo_10 = SetDO(DO=subtraction_3, Value=bool_3)  # -> simplify(Command)

panel_41 = Panel(setdo_10)
rev_2 = ReverseList(List=bool_3)

# ----
# merga direction
# and amount of steps
merge_commands = Merge(Data1=setdo_10, Data2=setdo_8)

# ---- group: Add alternating current state
viewer = ParamViewer(merge_commands)
panel_42 = Panel("""True
False""")
cull = CullPattern(List=viewer, CullPattern=panel_42)
split = SplitTree(Data=merge_commands, Masks=flatten(cull))  # -> Positive, Negative
ins = InsertItems(List=split.Negative, Item=setdo, Indices="-1", Wrap=True)
ins_2 = InsertItems(List=split.Positive, Item=setdo_2, Indices="-1", Wrap=True)
merge_7 = Merge(Data1=ins_2, Data2=ins)

# ----
# merga direction
# and amount of steps
merge_commands_2 = Merge(Data1=setdo_9, Data2=setdo_8)

# ---- group: Add alternating current state
viewer_2 = ParamViewer(merge_commands_2)
panel_43 = Panel("""True
False""")
cull_2 = CullPattern(List=viewer_2, CullPattern=panel_43)
split_2 = SplitTree(Data=merge_commands_2, Masks=flatten(cull_2))  # -> Positive, Negative
ins_3 = InsertItems(List=split_2.Negative, Item=setdo_3, Indices="-1", Wrap=True)
ins_4 = InsertItems(List=split_2.Positive, Item=setdo_4, Indices="-1", Wrap=True)
merge_8 = Merge(Data1=ins_4, Data2=ins_3)

# ----
# add delay while wheel moves
panel_44 = Panel("5")
wait = Wait(Time=panel_44)
ins_5 = InsertItems(List=merge_7, Item=wait, Indices="-1", Wrap=True)

# ----
# add delay while wheel moves
panel_45 = Panel("5")
wait_2 = Wait(Time=panel_45)
ins_6 = InsertItems(List=merge_8, Item=wait_2, Indices="-1", Wrap=True)

panel_46 = Panel(ins_6)

ins_7 = InsertItems(List=ins_5, Item=setdo_5, Indices="-1", Wrap=True)

# ---- group: Wheel Commands
panel_47 = Panel("""0
1
2
3
4
5
6
7""")
panel_48 = Panel("""0
0
0
0
0
0
0
0""")
groupcmd_2 = GroupCommand(Commands=ins_7)  # -> flatten(Command)
setdo_11 = SetDO(DO=panel_47, Value=panel_48)
groupcmd_3 = GroupCommand(Commands=setdo_11)  # -> flatten(Command)
panel_49 = Panel("""0
1
0
1
0
1
0
1
0
1
0
1
0
1
0
1""")
repeat_4 = RepeatData(Data=groupcmd_3, Length="12")
panel_50 = Panel("3")
weave_2 = Weave(Pattern=panel_49, Stream0=groupcmd_2, Stream1=repeat_4, NullGaps=False)
partition = PartitionList(List=groupcmd_2, Size=panel_50)

# ----
groupcmd_4 = GroupCommand(Commands=ins_6)  # -> flatten(Command)
partition_2 = PartitionList(List=groupcmd_4, Size=panel_50)

# ----
# Gripper open Com
panel_51 = Panel("False")
setdo_12 = SetDO(DO=subtraction_6, Value=panel_51)

merge_9 = Merge(Data1=setdo_6, Data2=setdo_12)

groupcmd_5 = GroupCommand(Commands=merge_9)

# ---- group: arrange plane and commands
list_2 = ValueList({"Joint", "Linear"}, selected="Linear")
list_3 = ValueList({"Joint", "Linear"}, selected="Linear")
list_4 = ValueList({"Joint", "Linear"}, selected="Linear")
list_5 = ValueList({"Joint", "Linear"}, selected="Linear")
target = CreateTarget(Plane=pln_3, Motion=list_2, Tool=tool_2, Command=groupcmd_5, IsCartesian=True)  # -> flatten(Target)
target_2 = CreateTarget(Plane=pln_5, Motion=list_4, Tool=tool_2, Command=partition_2, IsCartesian=True)
target_3 = CreateTarget(Plane=pln1, Motion=list_3, Tool=tool_2, Command=partition, IsCartesian=True)  # -> simplify(Target)
target_4 = CreateTarget(Plane=pln_4, Motion=list_5, Tool=tool_2, Command=groupcmd, IsCartesian=True)  # -> flatten(Target)
ins_8 = InsertItems(List=target_3, Item=target, Indices="3", Wrap=True)
ins_9 = InsertItems(List=ins_8, Item=target_4, Indices="4", Wrap=True)
ins_10 = InsertItems(List=ins_9, Item=target_2, Indices="5", Wrap=True)  # -> flatten(List)

# ---- group: ROBOT
program = CreateProgram(Name="DefaultProgram", RobotSystem=load_robot, Targets1=ins_10, StepSize=1)  # -> Program, Code, Duration, Warnings, Errors
list_of_commands = Panel(program.Code)
sim = ProgramSimulation(Program=program.Program, Time=Slider(0.19, range=0..1), Normalized=True)  # -> SystemMeshes, JointRotations, Plane, Index, Time, Program, Errors
panel_52 = Panel(program.Warnings)
